# Dynamo graph 1CОЗДАНИЕ ПАРАМЕТРОВ.dyn (Dynamo 1.3.2.2480)

code_block = CodeBlock()
# ---------- code_block.designscript (12 lines) ----------
"++ESKKSSiteOfInstallation";
"ESKKSTopNode";
"ESKKSTypeName";
"ESKKSSingleLevelLocationOnID";
"ESKKS-RDS-CW-TAG";
"ESKKSSingleLevelID";
"ESKKSClassName";
"ESKKSTypeID";
"+ESKKSPointOfInstallation";
"ESKKSClassCode";
"ESKKSSingleLevelLocationAtID";
"ESKKSMultiLevelID";
# ----------------------------------------
create = List.Create(code_block.out0, code_block.out1, code_block.out2, code_block.out3, code_block.out4, code_block.out5, code_block.out6, code_block.out7, code_block.out8, code_block.out9, code_block.out10, code_block.out11)
boolean = BoolSelector(true)
python_script = Python(IN[0]=boolean)
# ---------- python_script.python (28 lines) ----------
import clr
clr.AddReference('RevitAPI')
from Autodesk.Revit.DB import *
import Autodesk

clr.AddReference("RevitNodes")
import Revit
clr.ImportExtensions(Revit.Elements)

clr.AddReference("RevitServices")
import RevitServices
from RevitServices.Persistence import DocumentManager

doc = DocumentManager.Instance.CurrentDBDocument
params = []
cats = []
iterator = doc.ParameterBindings.ForwardIterator()
while iterator.MoveNext():
	params.append(iterator.Key.Name)
	thesecats = []
	for cat in iterator.Current.Categories:
		try:
			thesecats.append(Revit.Elements.Category.ById(cat.Id.IntegerValue))
		except:
			# in case the category is not supported by Dynamo
			pass
	cats.append(thesecats)
OUT = (params,cats)
# ----------------------------------------
code_block_2 = CodeBlock(seq=python_script) { seq[0]; seq[1]; }
code_block_3 = CodeBlock(paramName=code_block_2.out0) { paramName; }
containsItem = List.ContainsItem(list=code_block_3, item=create)
filterByBoolMask = List.FilterByBoolMask(list=create, mask=containsItem)
string_from_object = FromObject(filterByBoolMask.out)
code_block_4 = CodeBlock { "1"; "OTDELKA"; }
select_parameter_type = ParameterType("Text")
select_builtin_parameter_group = BuiltInParameterGroup("PG_IDENTITY_DATA")
boolean_2 = BoolSelector(true)
createProjectParameterForAllCategories = Parameter.CreateProjectParameterForAllCategories(string_from_object, code_block_4.out0, select_parameter_type, select_builtin_parameter_group, boolean_2)
code_block_5 = CodeBlock(categories=code_block_2.out1) { categories; }
