# Dynamo graph 2-Выделяет элементы, по равному значению в параметре (Параметр задается в ручную).dyn (Dynamo 1.3.2.2480)

boolean = BoolSelector(true)
level_element_collector = Custom[Level Element Collector](RunMe=boolean)  # This collects data for all of the Level elements in the model. Similar to the node on Lunchbox, but this one uses all O.O.B. nodes.
all_elements_at_level = ElementsAtLevel(level_element_collector.Element)
watch = Watch(all_elements_at_level)
поиск_по_параметру = StringInput("ESKKSClassCode")  # "Поиск по параметру ESKKSClassCode (можно заменить)"
getParameterValueByNameAsString = Custom[GetParameterValueByNameAsString](Element_s=watch, Parameter_Name=поиск_по_параметру)  # Returns paramter value as string. Same effect as lunchbox node, without python.
значение_параметра = StringInput("")
eq = getParameterValueByNameAsString == значение_параметра
filterByBoolMask = List.FilterByBoolMask(list=watch, mask=eq)
watch_2 = Watch(filterByBoolMask.in)
flatten = Flatten(watch_2)
boolean_2 = BoolSelector(true)
selectInView = Custom[Element.SelectInView](Element=flatten, Refresh_Boolean=boolean_2)  # Select the input elements in active view. Disconnect / Connect to refresh.
flatten_2 = Flatten(selectInView.Element_s)
count = List.Count(flatten_2)
количество_выбранных_элементов = Watch(count)
