# Dynamo graph 8 Тест ESKKEMultiLeveID.dyn (Dynamo 1.3.2.2480)

watch = Watch()  # frozen; unwired: arg0
flatten = Flatten(watch)
boolean = BoolSelector(true)
selectInView = Custom[Element.SelectInView](Element=flatten, Refresh_Boolean=boolean)  # Select the input elements in active view. Disconnect / Connect to refresh.
flatten_2 = Flatten(selectInView.Element_s)
count = List.Count(flatten_2)
количество_выбранных_элементов = Watch(count)
параметры = StringInput("""0: ++ESKKSSiteOfInstallation
1: ESKKSTopNode
2: ESKKSTypeName
3: ESKKSSingleLevelLocationOnID
4: ESKKS-RDS-CW-TAG
5: ESKKSSingleLevelID
6: ESKKSClassName
7: ESKKSTypeID
8: +ESKKSPointOfInstallation
9: ESKKSClassCode
10: ESKKSSingleLevelLocationAtID
11: ESKKSMultiLevelID""")
выбор_параметра = IntegerSlider(11, range=0..11 step 1)
boolean_2 = BoolSelector(true)
getRevitSelection = Custom[Tool.GetRevitSelection](reset=boolean_2)  # Get the selection from the Revit UI, use boolean action to refresh when selection must be updated
flatten_3 = Flatten(getRevitSelection)
watch_2 = Watch(flatten_3)
code_block = CodeBlock()
# ---------- code_block.designscript (24 lines) ----------
"++ESKKSSiteOfInstallation";
"ESKKSTopNode";
"ESKKSTypeName";
"ESKKSSingleLevelLocationOnID";
"ESKKS-RDS-CW-TAG";
"ESKKSSingleLevelID";
"ESKKSClassName";
"ESKKSTypeID";
"+ESKKSPointOfInstallation";
"ESKKSClassCode";
"ESKKSSingleLevelLocationAtID";
"ESKKSMultiLevelID";
0;
1;
2;
3;
4;
5;
6;
7;
8;
9;
10;
11;
# ----------------------------------------
create = List.Create(code_block.out12, code_block.out13, code_block.out14, code_block.out15, code_block.out16, code_block.out17, code_block.out18, code_block.out19, code_block.out20, code_block.out21, code_block.out22, code_block.out23)
create_2 = List.Create(code_block.out0, code_block.out1, code_block.out2, code_block.out3, code_block.out4, code_block.out5, code_block.out6, code_block.out7, code_block.out8, code_block.out9, code_block.out10, code_block.out11)
create_3 = List.Create(create, create_2)
transpose = List.Transpose(create_3)
code_block_2 = CodeBlock { 11; }
getItemAtIndex = List.GetItemAtIndex(list=transpose, index=code_block_2)
code_block_3 = CodeBlock { 1; }
getItemAtIndex_2 = List.GetItemAtIndex(list=getItemAtIndex, index=code_block_3)
string_from_object = FromObject(getItemAtIndex_2)
getParameterValueByNameAsString = Custom[GetParameterValueByNameAsString](Element_s=watch_2, Parameter_Name=string_from_object)  # frozen; Returns paramter value as string. Same effect as lunchbox node, without python.
filterByBoolMask = List.FilterByBoolMask(list=getParameterValueByNameAsString)  # unwired: mask
code_block_4 = CodeBlock { a.clean; }  # unwired: a
введите_префикс_для = StringInput("")  # "Введите префикс для ESKKSMultiLevelID"
code_block_5 = CodeBlock { 5; }
getItemAtIndex_3 = List.GetItemAtIndex(list=transpose, index=code_block_5)
code_block_6 = CodeBlock { 1; }
getItemAtIndex_4 = List.GetItemAtIndex(list=getItemAtIndex_3, index=code_block_6)
getParameterValueByNameAsString_2 = Custom[GetParameterValueByNameAsString](Element_s=watch_2, Parameter_Name=getItemAtIndex_4)
code_block_7 = CodeBlock(a=введите_префикс_для, b=getParameterValueByNameAsString_2) { a+"."+b; }
code_block_8 = CodeBlock { "."; }
eq = code_block_7 == code_block_8
filterByBoolMask_2 = List.FilterByBoolMask(list=watch_2, mask=eq)  # frozen
code_block_9 = CodeBlock { ""; }
setParameterByName = Element.SetParameterByName(element=filterByBoolMask_2.in, parameterName=string_from_object, value=code_block_9)
watch_3 = Watch(code_block_7)
code_block_10 = CodeBlock { "."; }
eq_2 = watch_3 == code_block_10
filterByBoolMask_3 = List.FilterByBoolMask(list=code_block_7, mask=eq)  # frozen
setParameterByName_2 = Element.SetParameterByName(element=filterByBoolMask_2.out, parameterName=string_from_object, value=filterByBoolMask_3.out)
boolean_3 = BoolSelector(true)
level_element_collector = Custom[Level Element Collector](RunMe=boolean_3)  # This collects data for all of the Level elements in the model. Similar to the node on Lunchbox, but this one uses all O.O.B. nodes.
all_elements_at_level = ElementsAtLevel(level_element_collector.Element)
code_block_11 = CodeBlock { 0.00000000000000000000001; }
getSurroundingElements = Custom[Tool.GetSurroundingElements](Element=watch_2, ElementCheck=all_elements_at_level, Tolerance=code_block_11)  # Get Surrounding Elements by Categories, group them as List. Tolerance distance available.
element_types = ElementTypes("Wall")
getType = Custom[Element.GetType]()  # Get the element type from an element; unwired: element
