# Dynamo graph 9 Поиск помещения и запись в параметр к выбранному элементу.dyn (Dynamo 1.3.2.2480)

в_какой_параметр_записывать_в = StringInput("++ESKKSSiteOfInstallation")  # "В какой параметр записывать в стене?"

# group: Запись данных
setParameterByName = Element.SetParameterByName(parameterName=в_какой_параметр_записывать_в)  # unwired: element, value

boolean = BoolSelector(true)
getRevitSelection = Custom[Tool.GetRevitSelection](reset=boolean)  # Get the selection from the Revit UI, use boolean action to refresh when selection must be updated
flatten = Flatten(getRevitSelection)
c_какого_параметра_помещения = StringInput("ESKKSMultiLevelID")  # "C какого параметра помещения брать значения?"
bv_get_parameter_value_as_string = Custom[bv Get Parameter Value as String](Parameter_Name=flatten, Element_s=c_какого_параметра_помещения)  # forked from Rhythm
c_какого_параметра_помещения_2 = StringInput("ESKKSSingleLevelID")  # "C какого параметра помещения брать значения?"
bv_get_parameter_value_as_string_2 = Custom[bv Get Parameter Value as String](Parameter_Name=flatten, Element_s=c_какого_параметра_помещения_2)
c_какого_параметра_помещения_3 = StringInput("+ESKKSPointOfInstallation")  # "C какого параметра помещения брать значения?"
bv_get_parameter_value_as_string_3 = Custom[bv Get Parameter Value as String](Parameter_Name=flatten, Element_s=c_какого_параметра_помещения_3)
code_block = CodeBlock(w=flatten, z=flatten, g=flatten, d=flatten)
# ---------- code_block.designscript (4 lines) ----------
w.GetParameterValueByName("ESKKSTopNode");
z.GetParameterValueByName("ESKKSMultiLevelID");
g.GetParameterValueByName("ESKKSSingleLevelID");
d.GetParameterValueByName("+ESKKSPointOfInstallation");
# ----------------------------------------
