# Dynamo graph 1 Выборка элементов по значениям (Слайдер).dyn (Dynamo 1.3.2.2480)

boolean = BoolSelector(true)
level_element_collector = Custom[Level Element Collector](RunMe=boolean)  # This collects data for all of the Level elements in the model. Similar to the node on Lunchbox, but this one uses all O.O.B. nodes.
all_elements_at_level = ElementsAtLevel(level_element_collector.Element)
flatten = Flatten(all_elements_at_level)
code_block = CodeBlock { "Тип"; }
getParameterValueByName = Element.GetParameterValueByName(element=flatten, parameterName=code_block, lacing=Longest)
code_block_2 = CodeBlock()
# ---------- code_block_2.designscript (24 lines) ----------
"++ESKKSSiteOfInstallation";
"ESKKSTopNode";
"ESKKSTypeName";
"ESKKSSingleLevelLocationOnID";
"ESKKS-RDS-CW-TAG";
"ESKKSSingleLevelID";
"ESKKSClassName";
"ESKKSTypeID";
"+ESKKSPointOfInstallation";
"ESKKSClassCode";
"ESKKSSingleLevelLocationAtID";
"ESKKSMultiLevelID";
0;
1;
2;
3;
4;
5;
6;
7;
8;
9;
10;
11;
# ----------------------------------------
create = List.Create(code_block_2.out12, code_block_2.out13, code_block_2.out14, code_block_2.out15, code_block_2.out16, code_block_2.out17, code_block_2.out18, code_block_2.out19, code_block_2.out20, code_block_2.out21, code_block_2.out22, code_block_2.out23)
create_2 = List.Create(code_block_2.out0, code_block_2.out1, code_block_2.out2, code_block_2.out3, code_block_2.out4, code_block_2.out5, code_block_2.out6, code_block_2.out7, code_block_2.out8, code_block_2.out9, code_block_2.out10, code_block_2.out11)
create_3 = List.Create(create, create_2)
transpose = List.Transpose(create_3)
выбор_параметра = IntegerSlider(9, range=0..11 step 1)
getItemAtIndex = List.GetItemAtIndex(list=transpose, index=выбор_параметра)
code_block_3 = CodeBlock { 1; }
getItemAtIndex_2 = List.GetItemAtIndex(list=getItemAtIndex, index=code_block_3)
string_from_object = FromObject(getItemAtIndex_2)
getParameterValueByNameAsString = Custom[GetParameterValueByNameAsString](Element_s=flatten, Parameter_Name=string_from_object)  # Returns paramter value as string. Same effect as lunchbox node, without python.
значение_параметра = StringInput("")
eq = getParameterValueByNameAsString == значение_параметра
filterByBoolMask = List.FilterByBoolMask(list=flatten, mask=eq)
filterByBoolMask_2 = List.FilterByBoolMask(list=filterByBoolMask.in)  # unwired: mask
watch = Watch(filterByBoolMask_2.out)
watch_2 = Watch(filterByBoolMask_2.in)
create_4 = List.Create(watch, watch_2)
flatten_2 = Flatten(filterByBoolMask.in)
boolean_2 = BoolSelector(true)
selectInView = Custom[Element.SelectInView](Element=flatten_2, Refresh_Boolean=boolean_2)  # Select the input elements in active view. Disconnect / Connect to refresh.
count = List.Count(selectInView.Element_s)
количество_выбранных_элементов = Watch(count)
параметры = StringInput("""0: ++ESKKSSiteOfInstallation
1: ESKKSTopNode
2: ESKKSTypeName
3: ESKKSSingleLevelLocationOnID
4: ESKKS-RDS-CW-TAG
5: ESKKSSingleLevelID
6: ESKKSClassName
7: ESKKSTypeID
8: +ESKKSPointOfInstallation
9: ESKKSClassCode
10: ESKKSSingleLevelLocationAtID
11: ESKKSMultiLevelID""")
