# Dynamo graph 10 У выбранных элементов собирает ESKKS-RDS-CW-TAG.dyn (Dynamo 1.3.2.2480)

boolean = BoolSelector(true)
getRevitSelection = Custom[Tool.GetRevitSelection](reset=boolean)  # Get the selection from the Revit UI, use boolean action to refresh when selection must be updated
flatten = Flatten(getRevitSelection)
в_какой_параметр_записывать_в = StringInput("ESKKS-RDS-CW-TAG")  # "В какой параметр записывать в стене?"
code_block = CodeBlock(w=flatten, z=flatten, g=flatten, d=flatten, q=flatten)
# ---------- code_block.designscript (5 lines) ----------
w.GetParameterValueByName("ESKKSTopNode");
z.GetParameterValueByName("ESKKSMultiLevelID");
g.GetParameterValueByName("ESKKSSingleLevelID");
d.GetParameterValueByName("+ESKKSPointOfInstallation");
q.GetParameterValueByName("++ESKKSSiteOfInstallation");
# ----------------------------------------
watch = Watch(code_block.out0)
watch_2 = Watch(code_block.out1)
watch_3 = Watch(code_block.out3)
code_block_2 = CodeBlock(a=watch, b=watch_2, c=watch_3, d=code_block.out4) { a+b+"/"+c+"/"+d; }

# group: Запись данных
setParameterByName = Element.SetParameterByName(element=flatten, parameterName=в_какой_параметр_записывать_в, value=code_block_2)

watch_4 = Watch(code_block.out2)
