# Dynamo graph 5 Присвоение выбранным элементов значений+инкремент (Slider).dyn (Dynamo 1.3.2.2480)

boolean = BoolSelector(true)
getRevitSelection = Custom[Tool.GetRevitSelection](reset=boolean)  # Get the selection from the Revit UI, use boolean action to refresh when selection must be updated
code_block = CodeBlock()
# ---------- code_block.designscript (24 lines) ----------
"++ESKKSSiteOfInstallation";
"ESKKSTopNode";
"ESKKSTypeName";
"ESKKSSingleLevelLocationOnID";
"ESKKS-RDS-CW-TAG";
"ESKKSSingleLevelID";
"ESKKSClassName";
"ESKKSTypeID";
"+ESKKSPointOfInstallation";
"ESKKSClassCode";
"ESKKSSingleLevelLocationAtID";
"ESKKSMultiLevelID";
0;
1;
2;
3;
4;
5;
6;
7;
8;
9;
10;
11;
# ----------------------------------------
create = List.Create(code_block.out12, code_block.out13, code_block.out14, code_block.out15, code_block.out16, code_block.out17, code_block.out18, code_block.out19, code_block.out20, code_block.out21, code_block.out22, code_block.out23)
create_2 = List.Create(code_block.out0, code_block.out1, code_block.out2, code_block.out3, code_block.out4, code_block.out5, code_block.out6, code_block.out7, code_block.out8, code_block.out9, code_block.out10, code_block.out11)
create_3 = List.Create(create, create_2)
transpose = List.Transpose(create_3)
выбор_параметра = IntegerSlider(11, range=0..11 step 1)
getItemAtIndex = List.GetItemAtIndex(list=transpose, index=выбор_параметра)
code_block_2 = CodeBlock { 1; }
getItemAtIndex_2 = List.GetItemAtIndex(list=getItemAtIndex, index=code_block_2)
string_from_object = FromObject(getItemAtIndex_2)
включить_автонумерацию = BoolSelector(true)
введите_значение_параметра = StringInput("ULD")
count = List.Count(getRevitSelection)
code_block_3 = CodeBlock(n=count) { 1..n; }
string_from_object_2 = FromObject(code_block_3)
введите_количество_нулей_перед = StringInput("2")  # "Введите количество нулей перед цифрой"
toNumber = String.ToNumber(введите_количество_нулей_перед)
code_block_4 = CodeBlock { "0"; }
padLeft = String.PadLeft(string_from_object_2, toNumber, code_block_4)
code_block_5 = CodeBlock(a=введите_значение_параметра, b=padLeft) { a+b; }
if_ = If(test=включить_автонумерацию, true=code_block_5, false=введите_значение_параметра)
setParameterByName = Element.SetParameterByName(element=getRevitSelection, parameterName=string_from_object, value=if_)
boolean_2 = BoolSelector(true)
selectInView = Custom[Element.SelectInView](Element=setParameterByName, Refresh_Boolean=boolean_2)  # Select the input elements in active view. Disconnect / Connect to refresh.
count_2 = List.Count(selectInView.Element_s)
количество_выбранных_элементов = Watch(count_2)
выбор_параметров = StringInput("""0: ++ESKKSSiteOfInstallation
1: ESKKSTopNode
2: ESKKSTypeName
3: ESKKSSingleLevelLocationOnID
4: ESKKS-RDS-CW-TAG
5: ESKKSSingleLevelID
6: ESKKSClassName
7: ESKKSTypeID
8: +ESKKSPointOfInstallation
9: ESKKSClassCode
10: ESKKSSingleLevelLocationAtID
11: ESKKSMultiLevelID""")
