# Dynamo graph 6 Выбор элементов имеющих значения(Параметр в Slider).dyn (Dynamo 1.3.2.2480)

выбор_параметров = StringInput("""0: ++ESKKSSiteOfInstallation
1: ESKKSTopNode
2: ESKKSTypeName
3: ESKKSSingleLevelLocationOnID
4: ESKKS-RDS-CW-TAG
5: ESKKSSingleLevelID
6: ESKKSClassName
7: ESKKSTypeID
8: +ESKKSPointOfInstallation
9: ESKKSClassCode
10: ESKKSSingleLevelLocationAtID
11: ESKKSMultiLevelID""")
boolean = BoolSelector(true)
level_element_collector = Custom[Level Element Collector](RunMe=boolean)  # This collects data for all of the Level elements in the model. Similar to the node on Lunchbox, but this one uses all O.O.B. nodes.
all_elements_at_level = ElementsAtLevel(level_element_collector.Element)
flatten = Flatten(all_elements_at_level)
code_block = CodeBlock()
# ---------- code_block.designscript (24 lines) ----------
"++ESKKSSiteOfInstallation";
"ESKKSTopNode";
"ESKKSTypeName";
"ESKKSSingleLevelLocationOnID";
"ESKKS-RDS-CW-TAG";
"ESKKSSingleLevelID";
"ESKKSClassName";
"ESKKSTypeID";
"+ESKKSPointOfInstallation";
"ESKKSClassCode";
"ESKKSSingleLevelLocationAtID";
"ESKKSMultiLevelID";
0;
1;
2;
3;
4;
5;
6;
7;
8;
9;
10;
11;
# ----------------------------------------
create = List.Create(code_block.out12, code_block.out13, code_block.out14, code_block.out15, code_block.out16, code_block.out17, code_block.out18, code_block.out19, code_block.out20, code_block.out21, code_block.out22, code_block.out23)
create_2 = List.Create(code_block.out0, code_block.out1, code_block.out2, code_block.out3, code_block.out4, code_block.out5, code_block.out6, code_block.out7, code_block.out8, code_block.out9, code_block.out10, code_block.out11)
create_3 = List.Create(create, create_2)
transpose = List.Transpose(create_3)
выбор_параметра = IntegerSlider(9, range=0..11 step 1)
getItemAtIndex = List.GetItemAtIndex(list=transpose, index=выбор_параметра)
code_block_2 = CodeBlock { 1; }
getItemAtIndex_2 = List.GetItemAtIndex(list=getItemAtIndex, index=code_block_2)
string_from_object = FromObject(getItemAtIndex_2)
getParameterValueByName = Element.GetParameterValueByName(element=flatten, parameterName=string_from_object)
length = String.Length(getParameterValueByName)
code_block_3 = CodeBlock { 0; }
eq = length == code_block_3
filterByBoolMask = List.FilterByBoolMask(list=flatten, mask=eq)
boolean_2 = BoolSelector(true)
selectInView = Custom[Element.SelectInView](Element=filterByBoolMask.out, Refresh_Boolean=boolean_2)  # Select the input elements in active view. Disconnect / Connect to refresh.
count = List.Count(selectInView.Element_s)
количество_выбранных_элементов = Watch(count)
