# Dynamo graph 9 Поиск элемента в помещении и присвоение SideOfInstallation.dyn (Dynamo 1.3.2.2480)

boolean = BoolSelector(true)
getRevitSelection = Custom[Tool.GetRevitSelection](reset=boolean)  # Get the selection from the Revit UI, use boolean action to refresh when selection must be updated
flatten = Flatten(getRevitSelection)
geometry = Element.Geometry(flatten)

# group: Убиваем пустые списки стен
flatten_2 = Flatten(flatten)
isEmpty = List.IsEmpty(geometry, lacing=Longest)
filterByBoolMask = List.FilterByBoolMask(list=flatten_2, mask=isEmpty)

levels = Levels("Level 1")
name = Level.Name(levels)

# group: Помещения по стадии + геометрия
categories = Categories("Rooms")
all_elements_of_category = ElementsOfCategory(categories)
code_block = CodeBlock { "Уровень"; }
getParameterValueByName = Element.GetParameterValueByName(element=all_elements_of_category, parameterName=code_block)
eq = getParameterValueByName == name
filterByBoolMask_2 = List.FilterByBoolMask(list=all_elements_of_category, mask=eq)
code_block_2 = CodeBlock(x=filterByBoolMask_2.in) { x; }
geometry_2 = Element.Geometry(code_block_2)

# group: Убираемя нулевые списки из помещений
code_block_3 = CodeBlock(x=geometry_2) { x; }
flatten_3 = Flatten(code_block_3)
isNull = Object.IsNull(flatten_3)
filterByBoolMask_3 = List.FilterByBoolMask(list=flatten_3, mask=isNull)
filterByBoolMask_4 = List.FilterByBoolMask(list=code_block_2, mask=isNull)

isEmpty_2 = List.IsEmpty(geometry, lacing=Longest)
filterByBoolMask_5 = List.FilterByBoolMask(list=geometry, mask=isEmpty_2)

# group: Логика пересечений
count = Count(filterByBoolMask_3.out)
ofRepeatedItem = List.OfRepeatedItem(item=filterByBoolMask.out, amount=count)
flatten_4 = Flatten(filterByBoolMask_5.out)
count_2 = Count(filterByBoolMask_3.out)
ofRepeatedItem_2 = List.OfRepeatedItem(item=flatten_4, amount=count_2)
doesIntersect = Geometry.DoesIntersect(geometry=filterByBoolMask_3.out, other=ofRepeatedItem_2)

в_какой_параметр_записывать_в = StringInput("++ESKKSSiteOfInstallation")  # "В какой параметр записывать в стене?"
c_какого_параметра_помещения = StringInput("ESKKSMultiLevelID")  # "C какого параметра помещения брать значения?"

# group: Отсекаем нулевые значения
filterByBoolMask_6 = List.FilterByBoolMask(list=ofRepeatedItem, mask=doesIntersect, lacing=Longest)
uniqueItems = List.UniqueItems(filterByBoolMask_6.in, lacing=Longest)
isEmpty_3 = List.IsEmpty(uniqueItems, lacing=Longest)
filterByBoolMask_7 = List.FilterByBoolMask(list=uniqueItems, mask=isEmpty_3)
getParameterValueByName_2 = Element.GetParameterValueByName(element=filterByBoolMask_4.out, parameterName=c_какого_параметра_помещения)
count_3 = Count(uniqueItems, lacing=Longest)
ofRepeatedItem_3 = List.OfRepeatedItem(item=getParameterValueByName_2, amount=count_3, lacing=Longest)
isEmpty_4 = List.IsEmpty(uniqueItems, lacing=Longest)
filterByBoolMask_8 = List.FilterByBoolMask(list=ofRepeatedItem_3, mask=isEmpty_4)

# group: Запись данных
code_block_4 = CodeBlock(x=filterByBoolMask_7.out) { x; }
code_block_5 = CodeBlock(x=filterByBoolMask_8.out) { x; }
setParameterByName = Element.SetParameterByName(element=code_block_4, parameterName=в_какой_параметр_записывать_в, value=code_block_5)
