# Dynamo graph TEST8 Находит соседнюю стену и вытаскивает из нее ESKKEMultiLeveID и вставляет в ESKKSPointOfInstallation.dyn (Dynamo 1.3.2.2480)

boolean = BoolSelector(true)
getRevitSelection = Custom[Tool.GetRevitSelection](reset=boolean)  # Get the selection from the Revit UI, use boolean action to refresh when selection must be updated
flatten = Flatten(getRevitSelection)
watch = Watch(flatten)
code_block = CodeBlock { "+ESKKSPointOfInstallation"; }
boolean_2 = BoolSelector(true)
level_element_collector = Custom[Level Element Collector](RunMe=boolean_2)  # This collects data for all of the Level elements in the model. Similar to the node on Lunchbox, but this one uses all O.O.B. nodes.
all_elements_at_level = ElementsAtLevel(level_element_collector.Element)
code_block_2 = CodeBlock { 0.00001; }
getSurroundingElements = Custom[Tool.GetSurroundingElements](Element=watch, ElementCheck=all_elements_at_level, Tolerance=code_block_2)  # Get Surrounding Elements by Categories, group them as List. Tolerance distance available.
flatten_2 = Flatten(getSurroundingElements)
categoryName = Custom[Get.CategoryName](Elements=getSurroundingElements)  # Get the category of an element
categories = Categories("Walls")
string_from_object = FromObject(categories)
eq = categoryName == string_from_object
filterByBoolMask = List.FilterByBoolMask(list=flatten_2, mask=eq)
watch_2 = Watch(filterByBoolMask.in)
code_block_3 = CodeBlock { "ESKKSMultiLevelID"; }
getParameterValueByNameAsString = Custom[GetParameterValueByNameAsString](Element_s=watch_2, Parameter_Name=code_block_3)  # Returns paramter value as string. Same effect as lunchbox node, without python.
setParameterByName = Element.SetParameterByName(element=watch, parameterName=code_block, value=getParameterValueByNameAsString)
name = Element.Name(flatten_2)
вывод_максимально_приближенных = Watch(name)  # "Вывод максимально приближенных элементов к выбранному"
