# Dynamo graph Поиск стен и запись в параметр Помещения.dyn (Dynamo 1.3.2.2480)

levels = Levels("АР_01_Этаж_0000")
name = Level.Name(levels)
значение_параметра_внутри_типа = StringInput("Отделка Стен")  # "Значение параметра внутри типа отделочных стен. Группа модели"

# group: Стены + геометрия
code_block = CodeBlock { "Отделка Стен"; }
categories = Categories("Walls")
all_elements_of_category = ElementsOfCategory(categories)
code_block_2 = CodeBlock(x=all_elements_of_category) { x; }
code_block_3 = CodeBlock { "Базовая зависимость"; }
getParameterValueByName = Element.GetParameterValueByName(element=code_block_2, parameterName=code_block_3)
name_2 = Level.Name(getParameterValueByName)
eq = name_2 == name
filterByBoolMask = List.FilterByBoolMask(list=code_block_2, mask=eq)
code_block_4 = CodeBlock { "Тип"; }
getParameterValueByName_2 = Element.GetParameterValueByName(element=filterByBoolMask.in, parameterName=code_block_4)
code_block_5 = CodeBlock { "Группа модели"; }
getParameterValueByName_3 = Element.GetParameterValueByName(element=getParameterValueByName_2, parameterName=code_block_5)
eq_2 = getParameterValueByName_3 == значение_параметра_внутри_типа
filterByBoolMask_2 = List.FilterByBoolMask(list=filterByBoolMask.in, mask=eq_2)
geometry = Element.Geometry(filterByBoolMask_2.in)

# group: Убиваем пустые списки стен
flatten = Flatten(filterByBoolMask_2.in)
isEmpty = List.IsEmpty(geometry, lacing=Longest)
filterByBoolMask_3 = List.FilterByBoolMask(list=flatten, mask=isEmpty)

# group: Помещения по стадии + геометрия
categories_2 = Categories("Rooms")
all_elements_of_category_2 = ElementsOfCategory(categories_2)
code_block_6 = CodeBlock { "Уровень"; }
getParameterValueByName_4 = Element.GetParameterValueByName(element=all_elements_of_category_2, parameterName=code_block_6)
eq_3 = getParameterValueByName_4 == name
filterByBoolMask_4 = List.FilterByBoolMask(list=all_elements_of_category_2, mask=eq_3)
code_block_7 = CodeBlock(x=filterByBoolMask_4.in) { x; }
geometry_2 = Element.Geometry(code_block_7)

# group: Убираемя нулевые списки из помещений
code_block_8 = CodeBlock(x=geometry_2) { x; }
flatten_2 = Flatten(code_block_8)
isNull = Object.IsNull(flatten_2)
filterByBoolMask_5 = List.FilterByBoolMask(list=flatten_2, mask=isNull)
filterByBoolMask_6 = List.FilterByBoolMask(list=code_block_7, mask=isNull)

isEmpty_2 = List.IsEmpty(geometry, lacing=Longest)
filterByBoolMask_7 = List.FilterByBoolMask(list=geometry, mask=isEmpty_2)

# group: Логика пересечений
count = Count(filterByBoolMask_5.out)
ofRepeatedItem = List.OfRepeatedItem(item=filterByBoolMask_3.out, amount=count)
flatten_3 = Flatten(filterByBoolMask_7.out)
count_2 = Count(filterByBoolMask_5.out)
ofRepeatedItem_2 = List.OfRepeatedItem(item=flatten_3, amount=count_2)
doesIntersect = Geometry.DoesIntersect(geometry=filterByBoolMask_5.out, other=ofRepeatedItem_2)

в_какой_параметр_записывать_в = StringInput("+ESKKSPointOfInstallation")  # "В какой параметр записывать в стене?"
c_какого_параметра_помещения = StringInput("ESKKSSingleLevelID")  # "C какого параметра помещения брать значения?"

# group: Отсекаем нулевые значения
filterByBoolMask_8 = List.FilterByBoolMask(list=ofRepeatedItem, mask=doesIntersect, lacing=Longest)
uniqueItems = List.UniqueItems(filterByBoolMask_8.in, lacing=Longest)
isEmpty_3 = List.IsEmpty(uniqueItems, lacing=Longest)
filterByBoolMask_9 = List.FilterByBoolMask(list=uniqueItems, mask=isEmpty_3)
getParameterValueByName_5 = Element.GetParameterValueByName(element=filterByBoolMask_6.out, parameterName=c_какого_параметра_помещения)
count_3 = Count(uniqueItems, lacing=Longest)
ofRepeatedItem_3 = List.OfRepeatedItem(item=getParameterValueByName_5, amount=count_3, lacing=Longest)
isEmpty_4 = List.IsEmpty(uniqueItems, lacing=Longest)
filterByBoolMask_10 = List.FilterByBoolMask(list=ofRepeatedItem_3, mask=isEmpty_4)

# group: Запись данных
code_block_9 = CodeBlock(x=filterByBoolMask_9.out) { x; }
code_block_10 = CodeBlock(x=filterByBoolMask_10.out) { x; }
setParameterByName = Element.SetParameterByName(element=code_block_9, parameterName=в_какой_параметр_записывать_в, value=code_block_10)
